% Simulink data dictionary DD_CAN_TX_RX.sldd
% references BMS_Software_DD_NXP.sldd

VCU_BMS_DATA = Simulink.Bus()
  Real_Time_Command_Packet_Data: Bus: Real_Time_Command_Packet_Data
  Configuration_Packet_1_Data: Bus: Configuration_Packet_1_Data
  Configuration_Packet_2_Data: Bus: Configuration_Packet_2_Data
  Configuration_Packet_3_Data: Bus: Configuration_Packet_3_Data
  Configuration_Packet_4_Data: Bus: Configuration_Packet_4_Data
  Configuration_Packet_5_Data: Bus: Configuration_Packet_5_Data

Configuration_Packet_5_Data = Simulink.Bus()
  Discharge_OverTemp_Error_Threshold: uint8
  Discharge_OverTemp_Warning_Threshold: uint8
  Discharge_LowTemp_Error_Threshold: uint8
  Discharge_LowTemp_Warning_Threshold: uint8
  Charging_OverTemp_Error_Threshold: uint8
  Charging_OverTemp_Warning_Threshold: uint8
  Charging_LowTemp_Error_Threshold: uint8
  Charging_LowTemp_Warning_Threshold: uint8

Configuration_Packet_4_Data = Simulink.Bus()
  Discharge_OverCurrent_Error_Threshold: uint16
  Discharge_OverCurrent_Warning_Threshold: uint16
  Charging_OverCurrent_Error_Threshold: uint16
  Charging_OverCurrent_Warning_Threshold: uint16

Configuration_Packet_3_Data = Simulink.Bus()
  Cell_OverVoltage_Error_Threshold: uint16
  Cell_OverVoltage_Warning_Threshold: uint16
  Cell_UnderVoltage_Error_Threshold: uint16
  Cell_UnderVoltage_Warning_Threshold: uint16

Configuration_Packet_2_Data = Simulink.Bus()
  OverVoltage_Error_Threshold: uint16
  OverVoltage_Warning_Threshold: uint16
  UnderVoltage_Error_Threshold: uint16
  UnderVoltage_Warning_Threshold: uint16

Configuration_Packet_1_Data = Simulink.Bus()
  Device_Info_Selection: uint8
  Disable_DC_DC: boolean
  Disable_Charging: boolean

Real_Time_Command_Packet_Data = Simulink.Bus()
  BMS_Run_Command: boolean
  Turn_Off_Insulation_Detection: boolean

Status_Packet1_Data = Simulink.Bus()
  OBC_Activation_Status: boolean
  OBC_Output_DC_Voltage: uint16
  OBC_Output_DC_Current: uint16
  OBC_Max_Temp: uint8
  AC_Input_Voltage: uint8
  AC_Input_Current: uint8

Status_Packet2_Data = Simulink.Bus()
  OBC_Error_1: boolean
  OBC_Error_2: boolean
  OBC_Error_3: boolean
  OBC_Error_4: boolean
  OBC_Error_5: boolean

OBC_BMS_DATA = Simulink.Bus()
  Status_Packet1_Data: Bus: Status_Packet1_Data
  Status_Packet2_Data: Bus: Status_Packet2_Data

ALL_RX_DATA = Simulink.Bus()
  VCU_BMS_DATA: Bus: VCU_BMS_DATA
  OBC_BMS_DATA: Bus: OBC_BMS_DATA

CAN_MESSAGE_BUS = Simulink.Bus()
  Extended: uint8
  Length: uint8
  Remote: uint8
  Error: uint8
  ID: uint32
  Timestamp: double
  Data: uint8[8]

BMS_ERROR_1 = Simulink.Bus()
  Total_High_Voltage: uint8
  Total_Low_Voltage: uint8
  Cell_High_Voltage: uint8
  Cell_Low_Voltage: uint8
  Volt_Diff_High: uint8
  Charging_Temp_High: uint8
  Charging_Temp_Low: uint8
  Insulation_Resistance_Low: uint8

BMS_ERROR_2 = Simulink.Bus()
  Discharge_Temp_High: uint8
  Discharge_Temp_Low: uint8
  Excessive_Temp_Diff: uint8
  Excessive_Discharge_Current: uint8
  Excessive_Charging_Current: uint8
  Battery_Sampling_Lost: uint8
  Discharge_Relay_Damaged: uint8
  Charging_Relay_Damaged: uint8

BMS_ERROR_3 = Simulink.Bus()
  Batt_Temp_Sensor_Fail: uint8
  Discharge_Fuse_Broken: uint8
  Charging_Fuse_Broken: uint8
  Precharge_Fail: uint8

OBC_ERROR = Simulink.Bus()
  HW_Failure: uint8
  Charging_Temp_Overrun: uint8
  Input_Voltage_Error: uint8
  Output_Current_Error: uint8
  Comms_Failure: uint8

Status_Packet4_Data_Tx = Simulink.Bus()
  BMS_ERROR_LEVEL: uint8
  BMS_ERROR_1: Bus: BMS_ERROR_1
  BMS_ERROR_2: Bus: BMS_ERROR_2
  BMS_ERROR_3: Bus: BMS_ERROR_3
  OBC_ERROR: Bus: OBC_ERROR

Status_Packet2_Data_Tx = Simulink.Bus()
  MAX_BUS_CURRENT: uint16
  MAX_REGEN_CURRENT: uint16
  HIGHEST_CELL_VOLTAGE: uint16
  LOWEST_CELL_VOLTAGE: uint16

ALL_TX_DATA = Simulink.Bus()
  Status_Packet1_Data_Tx: Bus: Status_Packet1_Data_Tx
  Status_Packet2_Data_Tx: Bus: Status_Packet2_Data_Tx
  Status_Packet3_Data_Tx: Bus: Status_Packet3_Data_Tx
  Status_Packet4_Data_Tx: Bus: Status_Packet4_Data_Tx

Status_Packet3_Data_Tx = Simulink.Bus()
  MAX_TEMP: uint8
  MAX_TEMP_NUMBER: uint8
  MIN_TEMP: uint8
  MIN_TEMP_NUMBER: uint8
  CHARGE_DISCHARGE_CYCLES: uint16

STATUS = Simulink.Bus()
  BMS_Status: uint8
  Predischarge_Relay: uint8
  Discharge_Relay: uint8
  Charging_Relay: uint8
  DC_DC_Enable: uint8
  Connected: uint8

Status_Packet1_Data_Tx = Simulink.Bus()
  STATUS: Bus: STATUS
  SOC: uint8
  SOH: uint8
  OUTPUT_DC: uint16
  OUTPUT_CURRENT: uint16

BMSSerialNo_Packet1 = Simulink.Bus()
  Byte1_4: uint32
  Byte5_8: uint32

BMSSerialNo_Packet2 = Simulink.Bus()
  Byte1_4: uint32
  Byte5_8: uint32

BMSFW_Version = Simulink.Bus()
  SerialNoByte1: uint8
  FW_Version: uint32

Status_Packet5 = Simulink.Bus()
  DeviceInfoSelection: uint8
  DisableDC_DC_Enable: uint8
  DisableCharging: uint8

Status_Packet6 = Simulink.Bus()
  OvervoltageErrorThreshold: uint16
  OvervoltageWarningThreshold: uint16
  UnderVoltageErrorThreshold: uint16
  UnderVoltageWarningThreshold: uint16

Status_Packet7 = Simulink.Bus()
  CellOvervoltageErrorThreshold: uint16
  CellOvervoltageWarningThreshold: uint16
  CellUndervoltageErrorThreshold: uint16
  CellUndervoltageWarningThreshold: uint16

Status_Packet8 = Simulink.Bus()
  DischargeOvercurrentErrorThreshold: uint16
  DischargeOvercurrentWarningThreshold: uint16
  ChargingOvercurrentErrorThreshold: uint16
  ChargingOvercurrentWarningThreshold: uint16

Status_Packet9 = Simulink.Bus()
  DischargeOvertempErrorThreshold: uint8
  DischargeOvertempWarningThreshold: uint8
  DischargeLowtempErrorThreshold: uint8
  DischargeLowtempWarningThreshold: uint8
  ChargingOvertempErrorThreshold: uint8
  ChargingOvertempWarningThreshold: uint8
  ChargingLowtempErrorThreshold: uint8
  ChargingLowtempWarningThreshold: uint8

Status_Packet10 = Simulink.Bus()
  CellVoltage1: uint16
  CellVoltage2: uint16
  CellVoltage3: uint16
  CellVoltage4: uint16

Status_Packet11 = Simulink.Bus()
  CellVoltage5: uint16
  CellVoltage6: uint16
  CellVoltage7: uint16
  CellVoltage8: uint16

Status_Packet12 = Simulink.Bus()
  CellVoltage9: uint16
  CellVoltage10: uint16
  CellVoltage11: uint16
  CellVoltage12: uint16

Status_Packet13 = Simulink.Bus()
  CellVoltage13: uint16
  CellVoltage14: uint16
  CellVoltage15: uint16
  CellVoltage16: uint16

Status_Packet14 = Simulink.Bus()
  CellVoltage17: uint16
  CellVoltage18: uint16
  CellVoltage19: uint16
  CellVoltage20: uint16

Real_Time_Command_Packet_To_OBC = Simulink.Bus()
  ActivateOBC: uint8
  AllowableChargingDCVoltage: uint16
  AllowableChargingDCCurrent: uint16
  SOC: uint8

Status_Packets = Simulink.Bus()
  Status_Packet5: Bus: Status_Packet5
  Status_Packet6: Bus: Status_Packet6
  Status_Packet7: Bus: Status_Packet7
  Status_Packet8: Bus: Status_Packet8
  Status_Packet9: Bus: Status_Packet9
  Status_Packet10: Bus: Status_Packet10
  Status_Packet11: Bus: Status_Packet11
  Status_Packet12: Bus: Status_Packet12
  Status_Packet13: Bus: Status_Packet13
  Status_Packet14: Bus: Status_Packet14

BMS_ID_Packets = Simulink.Bus()
  BMSSerialNo_Packet1: Bus: BMSSerialNo_Packet1
  BMSSerialNo_Packet2: Bus: BMSSerialNo_Packet2
  BMSFW_Version: Bus: BMSFW_Version

Tx_Event_Based = Simulink.Bus()
  BMS_ID_Packets: Bus: BMS_ID_Packets
  Status_Packets: Bus: Status_Packets
  Real_Time_Command_Packet_To_OBC: Bus: Real_Time_Command_Packet_To_OBC